# Grasshopper definition machineDrawing.ghx (Grasshopper 1.0.4)
# plug-ins: Python Interpreter, Silkworm

scale = Slider(0.161, range=0..1)
randomize = Button()
python = PythonScript(x=randomize)  # -> out, a
# ---------- python: Python ----------
__author__ = "leondo"

import rhinoscriptsyntax as rs

from random import randint
a = (randint(5,8))
print "Points: %d"  %a
# ---------- end python ----------
python_2 = PythonScript(x=randomize)  # -> out, a
# ---------- python_2: Python ----------
__author__ = "leondo"

import rhinoscriptsyntax as rs

import random
a = random.uniform(1.5,2.5)
print "Depth: %.5f mm"  %a
# ---------- end python_2 ----------
python_3 = PythonScript(x=randomize)  # -> out, a
# ---------- python_3: Python ----------
__author__ = "leondo"

import rhinoscriptsyntax as rs

from random import randint
a = (randint(300,400))
print "Height: %d mm"  %a
# ---------- end python_3 ----------
python_4 = PythonScript(x=randomize)  # -> out, a
# ---------- python_4: Python ----------
__author__ = "leondo"

import rhinoscriptsyntax as rs

from random import randint
a = (randint(300,400))
print "OG Depth: %d mm"  %a
# ---------- end python_4 ----------
python_5 = PythonScript(x=randomize)  # -> out, a
# ---------- python_5: Python ----------
__author__ = "leondo"

import rhinoscriptsyntax as rs

from random import randint
a = (randint(300,400))
print "Width: %d mm"  %a
# ---------- end python_5 ----------
number = Number(0.5)
sph = Sphere(Base=PlaneXY(0, 0, 0), Radius=number)
xy = XYPlane(Origin=Point(0, 0, 0))
scale_nu = ScaleNU(Geometry=sph, Plane=xy, ScaleX=python_5.a, ScaleY=python_3.a, ScaleZ=python_4.a)  # -> Geometry, Transform
scale_2 = Scale(Geometry=scale_nu.Geometry, Center=Point(0, 0, 0), Factor=scale)  # -> Geometry, Transform
bbox = BoundingBox(Content=scale_2.Geometry, Plane=PlaneXY(0, 0, 0))  # -> Box, Box_2
pop3d = Populate3D(Region=bbox.Box, Count=python.a, Seed=1)
multiplication = Multiplication(A=scale, B=python_4.a)
intcrv_t = InterpolateT(Vertices=pop3d, Degree=3, TangentStart=Vector(0, 0, 0), TangentEnd=Vector(0, 0, 0), KnotStyle=1)  # -> Curve, Length, Domain
connect = ConnectCurves(Curves=intcrv_t.Curve, Continuity=2, Close=True, Bulge=1)
num = Number(python_2.a)
division = Division(A=num, B=multiplication)
scale_nu_2 = ScaleNU(Geometry=connect, Plane=PlaneXY(0, 0, 0), ScaleX=1, ScaleY=1, ScaleZ=division)  # -> Geometry, Transform
xy_2 = XYPlane(Origin=Point(0, 0, 0))
x_tremez = Extremes(Curve=scale_nu_2.Geometry, Plane=xy_2)  # -> Highest, Lowest
pdecon = Deconstruct(Point=x_tremez.Highest)  # -> XComponent, YComponent, ZComponent
multiplication_2 = Multiplication(A=pdecon.ZComponent, B=-1)
Z = UnitZ(Factor=multiplication_2)
move = Move(Geometry=scale_nu_2.Geometry, Motion=Z)  # -> Geometry, Transform
loadsettings = LoadSettings(String=["absolute_extrudersteps = 1", "acceleration = 0", "bed_size = 200,200", "bed_temperature = 60", "bridge_fan_speed = 100", "bridge_flow_ratio = 1", "bridge_speed = 20", "brim_width = 3", "complete_objects = 0", "cooling = 0"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])
silkworm = SilkwormGenerator(SettingsDictionary=loadsettings, Geometry=flatten(move.Geometry), Sort=1)  # -> GCode, SilkwormModel
bbox_2 = BoundingBox(Content=move.Geometry, Plane=PlaneXY(0, 0, 0))  # -> Box, Box_2
box_corners = BoxCorners(Box=bbox_2.Box)  # -> CornerA, CornerB, CornerC, CornerD, CornerE, CornerF, CornerG, CornerH
panel = Panel(silkworm.GCode)
pt = Point(box_corners.CornerB)
pt_2 = Point(box_corners.CornerF)
pt_3 = Point(box_corners.CornerG)
pt_4 = Point(box_corners.CornerH)
dist = Distance(PointA=pt, PointB=pt_2)
dist_2 = Distance(PointA=pt_2, PointB=pt_3)
dist_3 = Distance(PointA=pt_3, PointB=pt_4)
dimensions_xyz = Panel([dist_3, dist_2, dist])
lng = ListLength(List=panel)
python_6 = PythonScript(x=lng)  # -> out, a
# ---------- python_6: Python ----------
__author__ = "leondo"

import rhinoscriptsyntax as rs

for i in range(9, x-4):
	print i
# ---------- end python_6 ----------
item = ListItem(List=panel, Index=python_6.out, Wrap=True)
panel_2 = Panel(item)
lng_2 = ListLength(List=panel_2)
python_7 = PythonScript(x=lng_2)  # -> out, a
# ---------- python_7: Python ----------
__author__ = "leondo"

import rhinoscriptsyntax as rs

for i in range(0, x):
	print i
# ---------- end python_7 ----------
item_2 = ListItem(List=panel_2, Index=python_7.out, Wrap=True)
python_8 = PythonScript(x=item_2)  # -> out, a
# ---------- python_8: Python ----------
__author__ = "leondo"

import rhinoscriptsyntax as rs



if "E" in x:
	x = x[x.index("X"):x.index("E")]
else:
	x = x[x.index("X"):]

print x
# ---------- end python_8 ----------
panel_3 = Panel("""G21 ;units in mm
G1Z-0.207F250. ;G1 is linear F is feed""")
panel_4 = Panel(python_8.out)
panel_5 = Panel([panel_3, panel_4])
gcode_copy_data_only = Panel(panel_5)
